# Grasshopper definition swarm_encoder.gh (Grasshopper 1.0.7)

pt = Point(<point referenced from the Rhino model>)
crv = Curve([<curve referenced from the Rhino model> x10])
pt_2 = Point([<point referenced from the Rhino model> x21])
pt_3 = Point([<point referenced from the Rhino model> x69])
pt_4 = Point([<point referenced from the Rhino model> x2])
python = GhPythonScript(x=pt)  # -> out, a; inputs x: Guid
# ---------- python: Python ----------
__author__ = "vp"
__version__ = "2020.03.12"

import rhinoscriptsyntax as rs
import scriptcontext as sc
import Rhino

#a = x.GetUserStrings()

#print(ghdoc)
#print(sc.doc)

sc.doc = Rhino.RhinoDoc.ActiveDoc

if x:
#       print(x)
    p = sc.doc.Objects.Find(x)
#    print(dir(p))
    print(p)
    print(type(p.Geometry.Location))
    
#    print(x.Id)
    keys = rs.GetUserText(x)
    vals = dict([[k, rs.GetUserText(x, k)] for k in keys])

    print(vals)

#print(type(x))
#print(x.UserDictionary.Keys)
#print(a.AllKeys)
#print(x.GetUserString('power'))

#print(dir(x))
#print(x.ObjectId)
# ---------- end python ----------
python_2 = GhPythonScript(obstacle_polylines=crv, obstacle_points=pt_2, attractor_points=pt_3, emitter_points=pt_4)  # -> out, a; inputs obstacle_polylines: list of Guid, obstacle_points: list of Guid, attractor_points: list of Guid, emitter_points: list of Guid
# ---------- python_2: Python ----------
__author__ = "tmshv"
__version__ = "2020.03.12"

import json
import rhinoscriptsyntax as rs
import scriptcontext as sc
import Rhino

TYPE_OBSTACLE = 'obstacle'
TYPE_ATTRACTOR = 'attractor'
TYPE_EMITTER = 'emitter'

sc.doc = Rhino.RhinoDoc.ActiveDoc

def get_props(obj, prop_def):    
    p = {}
    for key, default_value in prop_def:
        t = type(default_value)
        v = rs.GetUserText(obj, key)
        p[key] = t(v) if v else default_value
    return p

def create_geometry(p):
    if isinstance(p, Rhino.Geometry.Point):
        return {
            'type': 'point',
            'coordinates': [p.Location.X, p.Location.Y],
        }
    if isinstance(p, Rhino.Geometry.PolylineCurve):
        pl = p.ToPolyline()
        return {
            'type': 'polyline',
            'coordinates': [
                [i.X, i.Y]
                for i in pl
            ],
        }
    return {}

def create_object(guid, object_type, prop_def):
    obj = sc.doc.Objects.Find(guid)
    props = get_props(obj, prop_def)
    o = {
        'type': object_type,
        'properties': props,
        'geometry': create_geometry(obj.Geometry)
    }
        
    return o

def create_obstacle(p):
    return create_object(p, TYPE_OBSTACLE, [])

def create_attractor(p):
    return create_object(p, TYPE_ATTRACTOR, [
        ['type', 'attractor'],
        ['power', 1],
    ])

def create_emitter(p):
    return create_object(p, TYPE_EMITTER, [
        ['type', 'emitter'],
        ['power', 1],
    ])

obs_pl = [
    create_obstacle(x)
    for x in obstacle_polylines
]

obs_p = [
    create_obstacle(x)
    for x in obstacle_points
]

attractors = [
    create_attractor(x)
    for x in attractor_points
]

emitters = [
    create_emitter(x)
    for x in emitter_points
]

objs = obs_pl + obs_p + attractors + emitters

definition = {
    'version': '1.0',
    'objects': objs,
}

a = json.dumps(definition, indent=4)

#    for x in list(pl):
#        print(x)
#for pl in obstacle_polylines:
#    for x in list(pl):
#        print(x)
#print(list(pl))
#print(dir(pl))
# ---------- end python_2 ----------
panel = Panel(python_2.a)
